# Grasshopper definition ALP_3DVisualization.gh (Grasshopper 1.0.8)

path = FilePath("C:\Users\cynth\Desktop\SCI6492\0_Final\data\posters_cleaned_3_gh.csv")
file = ReadFile(F=path, PerLineParse=True)  # -> C
#   port F: Uri of file to read
# ---------- file: VB line parser ----------
    action = GH_LineParserAction.Include
    Return line

    'Parse the line and return some data that represents the line.
    'If the line cannot be parsed, you can return Nothing and
    'assign a different action.
    'The default implementation is to just return the line itself.
    'If you return types that implement IGH_Goo, this component
    'will work substantially faster.
# ---------- end file ----------
split = TextSplit(Text=file, Separators=",")
item = ListItem(List=split, Index="2", Wrap=True)  # -> simplify(flatten(Item))
item_2 = ListItem(List=split, Index="21", Wrap=True)  # -> simplify(flatten(Item))
item_3 = ListItem(List=split, Index="1", Wrap=True)  # -> simplify(flatten(Item))
item_4 = ListItem(List=split, Index="0", Wrap=True)  # -> simplify(flatten(Item))
item_5 = ListItem(List=split, Index="22", Wrap=True)  # -> simplify(flatten(Item))
item_6 = ListItem(List=split, Index="23", Wrap=True)  # -> simplify(flatten(Item))
panel = Panel(split)
cull_i = CullIndex(List=item_2, Indices="0", Wrap=True)  # -> flatten(List)
cull_i_2 = CullIndex(List=item, Indices="0", Wrap=True)  # -> flatten(List)
cull_i_3 = CullIndex(List=item_3, Indices="0", Wrap=True)  # -> flatten(List)
cull_i_4 = CullIndex(List=item_6, Indices="0", Wrap=True)  # -> flatten(List)
cull_i_5 = CullIndex(List=item_5, Indices="0", Wrap=True)  # -> flatten(List)
cull_i_6 = CullIndex(List=item_4, Indices="0", Wrap=True)  # -> flatten(List)
panel_2 = Panel(cull_i_6)
panel_3 = Panel(cull_i_2)
panel_4 = Panel(cull_i_3)
panel_5 = Panel(cull_i)
panel_6 = Panel(cull_i_5)
panel_7 = Panel(cull_i_4)
expression = Expression(x=Slider(28, range=0..100), Expression="x-1")
range = Range(Domain=Slider(4, range=0..10), Steps=expression)
lng = ListLength(List=range)
series = Series(Start=Slider(43, range=0..100), Step=Slider(6, range=0..100), Count=lng)
pi = Pi(Factor=range)
pi_2 = Pi(Factor=range)
cos = Cosine(Value=pi)
sin = Sine(Value=pi_2)
multiplication = Multiplication(A=cos, B=series)
multiplication_2 = Multiplication(A=sin, B=series)
multiplication_3 = Multiplication(A=range, B=Slider(64, range=0..100))
neg = Negative(Value=multiplication_3)
pt = ConstructPoint(XCoordinate=multiplication, YCoordinate=multiplication_2, ZCoordinate="0")
intcrv = Interpolate(Vertices=pt, Degree=3, Periodic=False, KnotStyle=1)  # -> Curve, Length, Domain
xz = XZPlane(Origin=pt)
xy = XYPlane(Origin=pt)
crv = Curve(intcrv.Curve)
panel_8 = Panel(pt)
rev = ReverseList(List=xz)
pi_3 = Pi(Factor=Slider(0, range=0..1))
rotate = Rotate(Geometry=xz, Angle=pi_3, Plane=xz)  # -> Geometry, Transform
number_slider = Slider(23, range=0..100)
pln = Plane(rotate.Geometry)
rectangle = Rectangle(Plane=pln, XSize=number_slider, YSize=number_slider, Radius=0)  # -> Rectangle, Length

# ---- group: RES
number_slider_2 = Slider(100, range=0..100)

# ----
area = Area(Geometry=rectangle.Rectangle)  # -> Area, Centroid
vec2pt = Vector2Pt(PointA=area.Centroid, PointB=pln, Unitize=False)  # -> Vector, Length
panel_9 = Panel(panel_4)
move = Move(Geometry=rectangle.Rectangle, Motion=vec2pt.Vector)  # -> Geometry, Transform
cset = CreateSet(List=panel_5)  # -> Set, Map
graft = GraftTree(Tree=cset.Set, IncludeEmptyLists=True, IncludeNullItems=True)
rec = Rectangle(move.Geometry)
mindex = MemberIndex(Set=graft, Member=panel_5)  # -> Index, Count
img = ImportImage(File=panel_9, Rectangle=rec, XSamples=number_slider_2, YSamples=number_slider_2)
dispatch = Dispatch(List=img, DispatchPattern=mindex.Count)  # -> ListA, ListB
dispatch_2 = Dispatch(List=rec, DispatchPattern=mindex.Count)  # -> ListA, ListB
mesh = Mesh(dispatch.ListA)
area_2 = Area(Geometry=dispatch_2.ListA)  # -> Area, Centroid

# ---- group: Bake this
group = Group(Objects=mesh)

# ----
scale = Scale(Geometry=dispatch_2.ListA, Center=area_2.Centroid, Factor=Slider(1.2, range=0..10))  # -> Geometry, Transform
merge = Merge(Data1=graft(dispatch_2.ListA), Data2=graft(scale.Geometry))  # -> simplify(Result)
loft = Loft(Curves=merge, Options={Adjust=False, Closed=False, LoftEnds=0, LoftSimp=0, LoftType=0, Rebuild=10, Refit=0.01})
fmerge = MergeFaces(Brep=loft)  # -> Breps, Before, After
trim = TrimTree(Tree=fmerge.Breps, Depth=1)
bang = ExplodeTree(Data=trim)  # -> Branch0, Branch1, Branch2, Branch3
group_2 = Group(Geometry=bang.Branch3)
group_3 = Group(Geometry=bang.Branch1)
group_4 = Group(Geometry=bang.Branch2)
group_5 = Group(Geometry=bang.Branch0)
